# Grasshopper definition TestGemini.gh (Grasshopper 1.0.8)
# plug-ins: jSwan, ToggleV6, GrassBananaPro

trigger = Trigger(Interval=-1000, TimerInterval=1000, Target=viewport_capture_to_gimage)
viewport_capture_to_gimage = ViewportCaptureToGImage(ZoomToCrop=False, MaxGImageSize=Slider(500, range=0..1000), UseGImageWidth=True, ForceRefresh=True)
file_path = FilePath("D:\Desktop\Img.png")
geometry = Geometry([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])
custom_preview = CustomPreview(Geometry=geometry, Material=ColourSwatch(SwatchColor=RGB(242, 242, 242)))
preview_image = PreviewImage(GImage=viewport_capture_to_gimage)
preview_image_2 = PreviewImage(FilePath=file_path)
panel = Panel()
list = ValueList({"1:1", "2:3", "3:2", "3:4", "4:3", "4:5", "5:4", "9:16", "16:9", "21:9"}, selected="16:9")
list_2 = ValueList({"1K", "2K", "4K"}, selected="1K")
panel_2 = Panel("A Beautiful buildings in a crowed city, dramatic realistic lighting. A gian banana like the input img on top of the 2 building")
gemini_image_generator = GeminiImageGenerator(
    Prompt=panel_2,
    InputImages=flatten([preview_image, preview_image_2]),
    ImageSize=list_2,
    AspectRatio=list,
    Generate=Button(),
    APIKey=panel)  # -> GImage, Text, Status, RawResponse
deserialize_json = DeserializeJson(JSON=gemini_image_generator.RawResponse, OutputsLocked=False)  # -> Candidates, UsageMetadata, ModelVersion, ResponseId
panel_3 = Panel(deserialize_json.UsageMetadata)
panel_4 = Panel(deserialize_json.ModelVersion)
panel_5 = Panel(gemini_image_generator.Text)
panel_6 = Panel(gemini_image_generator.Status)
panel_7 = Panel(deserialize_json.ResponseId)
preview_image_3 = PreviewImage(GImage=gemini_image_generator.GImage)
export_gimage = ExportGImage(GImage=preview_image_3, FolderPath="D:\Desktop", FileName=panel_7, Export=Toggle(SpecialInteger=True), Overwrite=False)
panel_8 = Panel(export_gimage)
